# Grasshopper definition InputSurface_Hops.gh (Grasshopper 1.0.7)
# Copyright: tiaoo
# Copyright: Mattia

# Acceptance Criteria: slicing sheet is not closed
# sheet covers the bounding box for the object to print
# sheet have an intersection with the object that will be printed
# generate "good result" (no zero lenght line/no multiple sections if the geometry is not multi branched)
# sheets bounding box bottom is higher than the bounding box of print object
inputgeo = GetGeometry(AtLeast=1, AtMost=2147483647, Filter=1074004029)
inputgeo_2 = Geometry(inputgeo)

join = BrepJoin(Breps=inputgeo_2)  # -> Breps, Closed; disabled
panel = Panel(join.Breps)  # disabled

geo_properties = GeoProperties(inputgeo=inputgeo_2)  # -> amountelements_2, printinggeo_2, slicingsheet_2

geometry_open = GeometryOpen(slicingsheet=geo_properties.slicingsheet_2)
ifnullfalse = IfNullFalse(input=geometry_open)
panel_2 = Panel(ifnullfalse)

sheet_covers_bbox = SheetCoversBbox(printinggeo=geo_properties.printinggeo_2, slicingsheet=geo_properties.slicingsheet_2)
ifnullfalse_2 = IfNullFalse(input=sheet_covers_bbox)
panel_3 = Panel(ifnullfalse_2)

sheet_intersect_printing = SheetIntersectPrinting(printinggeo=geo_properties.printinggeo_2, slicingsheet=geo_properties.slicingsheet_2)
ifnullfalse_3 = IfNullFalse(input=sheet_intersect_printing)
panel_4 = Panel(ifnullfalse_3)

good_result = SheetIntersectPrinting(printinggeo=geo_properties.printinggeo_2, slicingsheet=geo_properties.slicingsheet_2)
ifnullfalse_4 = IfNullFalse(input=good_result)
panel_5 = Panel(ifnullfalse_4)

and = GateAnd(A=ifnullfalse, B=ifnullfalse_2, C=ifnullfalse_3, D=ifnullfalse_4)
merge = Merge(Data1=ifnullfalse, Data2=ifnullfalse_2, Data3=ifnullfalse_3, Data4=ifnullfalse_4)
slicingsheet = StreamFilter(AcceptationCriteria=and, Stream1=geo_properties.slicingsheet_2)

clean = CleanTree(RemoveNulls=True, RemoveInvalid=True, RemoveEmpty=invert(False), Tree=slicingsheet)
lng = ListLength(List=clean)
larger = LargerThan(FirstNumber=lng, SecondNumber=0)  # -> LargerThan, OrEqualTo

null = NullItem(Item=slicingsheet)  # -> NullFlags, InvalidFlags, Description
equals = Equality(FirstNumber=null.NullFlags, SecondNumber=0)  # -> Equality, Inequality
filter = StreamFilter(Gate=equals.Equality, Stream0="False", Stream1=larger.LargerThan)

filter_2 = StreamFilter(Gate=filter, Stream0=inputgeo_2, Stream1=geo_properties.printinggeo_2)

# ---- group: RH_OUT:acceptationCriteriaOutput
acceptationcriteriaoutput = Boolean(merge)

# ---- group: RH_OUT:slicingSheetBool
slicingsheetbool = Boolean(filter)

# ---- group: RH_OUT:slicingSheet
slicingsheet_2 = Geometry(slicingsheet)

# ---- group: RH_OUT:printingGeo
printinggeo = Geometry(filter_2)

# ----
guid = GhPythonScript(input=printinggeo)  # -> a
# ---------- guid: Python ----------
__author__ = "matti"
__version__ = "2021.05.06"

import rhinoscriptsyntax as rs

print input
a = str(input)
# ---------- end guid ----------
panel_6 = Panel(guid)

# ---- group: RH_OUT:printingGeoID
printinggeoid = Text(guid)

# ==== cluster GeometryOpen
slicingsheet = ClusterInput()
slicingsheet_2 = Data(slicingsheet)
closedbrep = CSharpScript(brep=slicingsheet_2)  # -> flatten(P), t; inputs brep: GeometryBase
# ---------- closedbrep: C# usings ----------
using System.IO;
using System.Linq;
using System.Data;
using System.Drawing;
using System.Reflection;
using System.Windows.Forms;
using System.Xml;
using System.Xml.Linq;
using System.Runtime.InteropServices;
using Rhino.DocObjects;
using Rhino.Collections;
using GH_IO;
using GH_IO.Serialization;
# ---------- closedbrep: C# ----------
    System.Diagnostics.Stopwatch sw = new System.Diagnostics.Stopwatch();
    sw.Start();

    //0.Geometry is closed
    if(brep is Brep){
      P = (brep as Brep).IsSolid;
    } else {
      P = false;
    }

    sw.Stop();
    t = (string.Format("Elapsed: {0}ms", sw.Elapsed.TotalMilliseconds));
# ---------- end closedbrep ----------

null = NullItem(Item=closedbrep.P)  # -> NullFlags, InvalidFlags, Description
ma = MassAddition(Input=flatten(null.NullFlags))  # -> Result, PartialResults

bool = Boolean(invert(closedbrep.P))
false = Boolean(False)
filter = StreamFilter(Gate=ma.Result, Stream0=bool, Stream1=false)
opengeometrybool = Boolean(flatten(filter))
opengeometrybool_2 = ClusterOutput(opengeometrybool)

# ==== cluster SheetCoversBbox
printinggeo = ClusterInput()
slicingsheet = ClusterInput()
slicingsheet_2 = Data(slicingsheet)
printinggeo_2 = Data(printinggeo)

bbox = BoundingBox(Content=printinggeo_2, Plane=PlaneXY(0, 0, 0))  # -> Box, Box_2
debrep = DeconstructBrep(Brep=bbox.Box)  # -> Faces, Edges, Vertices

area = Area(Geometry=debrep.Faces)  # -> Area, Centroid
pdecon = Deconstruct(Point=area.Centroid)  # -> XComponent, YComponent, ZComponent
sort = SortList(Keys=pdecon.ZComponent, ValuesA=debrep.Faces)  # -> Keys, ValuesA

item = ListItem(List=sort.ValuesA, Index=0, Wrap=True)
area_2 = Area(Geometry=item)  # -> Area, Centroid
project = Project(Geometry=slicingsheet_2, Plane=area_2.Centroid)  # -> Geometry, Transform
slicinggeopro = Data(project.Geometry)
basebbox = Data(item)

debrep_2 = DeconstructBrep(Brep=basebbox)  # -> Faces, Edges, Vertices
join = JoinCurves(Curves=debrep_2.Edges, Preserve=False)

debrep_3 = DeconstructBrep(Brep=slicinggeopro)  # -> Faces, Edges, Vertices
join_2 = JoinCurves(Curves=debrep_3.Edges, Preserve=False)

disc = Discontinuity(Curve=join_2, Level=3)  # -> Points, Parameters
hull = ConvexHull(Points=flatten(disc.Points), Plane=PlaneXY(0, 0, 0))  # -> Hull, HullZ, Indices

disc_2 = Discontinuity(Curve=hull.Hull, Level=1)  # -> Points, Parameters
disc_3 = Discontinuity(Curve=hull.Hull, Level=2)  # -> Points, Parameters
disc_4 = Discontinuity(Curve=hull.Hull, Level=3)  # -> Points, Parameters
merge = Merge(Data1=disc_2.Points, Data2=disc_3.Points, Data3=disc_4.Points)

alongcrv = SortAlongCurve(Points=merge, Curve=hull.Hull)  # -> Points, Indices

incurve = PointInCurve(Point=alongcrv.Points, Curve=join)  # -> Relationship, Point
equals = Equality(FirstNumber=incurve.Relationship, SecondNumber=2)  # -> Equality, Inequality

ma = MassAddition(Input=equals.Equality)  # -> Result, PartialResults
equals_2 = Equality(FirstNumber=ma.Result, SecondNumber=0)  # -> Equality, Inequality

sheetcovergeobool = Data(flatten(equals_2.Equality))
sheetcovergeobool_2 = ClusterOutput(sheetcovergeobool)

# ==== cluster GeoProperties
inputgeo = ClusterInput()
inputgeo_2 = Data(inputgeo)

join = BrepJoin(Breps=inputgeo_2)  # -> Breps, Closed
bbox = BoundingBox(Content=join.Breps, Plane=PlaneXY(0, 0, 0))  # -> Box, Box_2

debrep = DeconstructBrep(Brep=bbox.Box)  # -> Faces, Edges, simplify(Vertices)
pdecon = Deconstruct(Point=debrep.Vertices)  # -> XComponent, YComponent, ZComponent
sort = SortList(Keys=pdecon.ZComponent, ValuesA=debrep.Vertices)  # -> Keys, ValuesA
item = ListItem(List=sort.ValuesA, Index=0, Wrap=True)
flatten = FlattenTree(Tree=item, Path="{0}")
pdecon_2 = Deconstruct(Point=flatten)  # -> XComponent, YComponent, ZComponent

sort_2 = SortList(Keys=pdecon_2.ZComponent, ValuesA=join.Breps)  # -> Keys, ValuesA

cull_i = CullIndex(List=sort_2.ValuesA, Indices=0, Wrap=True)
item_2 = ListItem(List=sort_2.ValuesA, Index=0, Wrap=True)
lng = ListLength(List=inputgeo_2)
amountelements = Data(lng)
printinggeo = Data(item_2)
slicingsheet = Data(cull_i)
amountelements_2 = ClusterOutput(amountelements)
printinggeo_2 = ClusterOutput(printinggeo)
slicingsheet_2 = ClusterOutput(slicingsheet)

# ==== cluster SheetIntersectPrinting
printinggeo = ClusterInput()
slicingsheet = ClusterInput()
slicingsheet_2 = Data(slicingsheet)
printinggeo_2 = Data(printinggeo)

bbx = BrepBrep(BrepA=printinggeo_2, BrepB=slicingsheet_2)  # -> Curves, Points
clean = CleanTree(RemoveNulls=True, RemoveInvalid=True, RemoveEmpty=invert(False), Tree=bbx.Curves)
lng = ListLength(List=clean)
larger = LargerThan(FirstNumber=lng, SecondNumber=0)  # -> LargerThan, OrEqualTo

intslicegeobool = Data(flatten(larger.LargerThan))
intslicegeobool_2 = ClusterOutput(intslicegeobool)

# ==== cluster IfNullFalse
input = ClusterInput()
input_2 = Data(input)

null = NullItem(Item=input_2)  # -> NullFlags, InvalidFlags, Description
equals = Equality(FirstNumber=null.NullFlags, SecondNumber=0)  # -> Equality, Inequality
filter = StreamFilter(Gate=equals.Equality, Stream0="False", Stream1=input_2)

output = Data(filter)
output_2 = ClusterOutput(output)
